# Grasshopper definition CgalTest.gh (Grasshopper 1.0.7)

rel = GhPythonScript(path="config.json")  # -> a
# ---------- rel: Python ----------
ghenv.Component.NickName = "Rel"

import rhinoscriptsyntax as rs

dir = rs.DocumentPath()
a = dir + "spec\\" + path
# ---------- end rel ----------
file = ReadFile(File=rel, PerLineParse=False)
dll = ImportDll(asm="CgalUtilWrapper.dll", config=file)  # -> dll
# ---------- dll: Python ----------
ghenv.Component.Name = "Import Dll"
ghenv.Component.NickName = "Dll"

import rhinoscriptsyntax as rs
import System.IO as io
import clr, json

cwd = io.Path.GetDirectoryName(ghenv.Component.OnPingDocument().FilePath) + "/spec/"
io.Directory.SetCurrentDirectory(cwd)

thisDir = rs.DocumentPath();
cfg = json.loads(config)
binDir = io.Directory.GetParent(thisDir).Parent.Parent.FullName + "\\x64\\" + cfg["build"] + "\\"
asmPath = binDir + asm
dll = asmPath

clr.AddReferenceToFileAndPath(asmPath)
# ---------- end dll ----------

pt = Point([Point(76.75470275, 43.65303195, 0), Point(5.702607272, -5.587722585, 0), Point(42.23347137, 52.80156046, 0)])
pt_2 = Point([Point(-17.81812329, 26.69048654, 0), Point(17.19715638, 49.76040107, 0), Point(4.615978363, 13.3552902, 0), Point(-9.829711274, 15.56266863, 0), Point(-41.6688246, -13.42205658, 0)])
pt_3 = Point([Point(57.62802464, -96.5009216, 0), Point(108.7557906, -79.63678936, 0), Point(87.0733349, -56.08054115, 0), Point(-31.64105221, -54.1675274, 0)])
pt_4 = Point([Point(54.40490909, 85.79482679, 0), Point(-2.66676122, 65.30286978, 0), Point(-35.40726939, 45.3550105, 0), Point(-83.85608051, -42.6009072, 0), Point(-7.516387235, -80.60551641, 0), Point(-19.08300743, -128.1938966, 0), Point(170.9674266, -107.1648866, 0), Point(128.7966889, 5.404275297, 0), Point(91.04208104, 68.93855822, 0)])
pline = PolyLine(Vertices=pt, Closed=True)
pline_2 = PolyLine(Vertices=pt_2, Closed=True)
pline_3 = PolyLine(Vertices=pt_3, Closed=True)
pline_4 = PolyLine(Vertices=pt_4, Closed=True)
merge = Merge(Data1=pline_3, Data2=pline_2, Data3=pline)  # -> flatten(Result)

brep = Brep(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)
mesh = MeshBrep(
    Brep=brep,
    Settings={GridMaxCount=0, GridMinCount=16, JaggedSeams=False, MaxEdgeLength=0, MinEdgeLength=0.0001, MinTolerance=0, Refine=True, RefineAngle=0, RelativeTolerance=0.65, SimplePlanes=True, Tolerance=0})

c_script = CSharpScript(path="spec/OptimalBoundingBox.py", refresh=Button())  # -> out, A; inputs path: String, refresh: Boolean
# ---------- c_script: C# usings ----------
using System.IO;
# ---------- c_script: C# ----------
    string thisDir = Path.GetDirectoryName(this.Component.OnPingDocument().FilePath);
        string file = File.ReadAllText(thisDir + @"\" + path);
    A = file;
# ---------- end c_script ----------
optimalboundingbox = Instance(Code=c_script.A, Dll=dll, Mesh=mesh)  # -> Out, Obb

c_script_2 = CSharpScript(path="spec/ConvexHull.py", refresh=Button())  # -> out, A; inputs path: String, refresh: Boolean; same code as c_script
convexhull = Instance(Code=c_script_2.A, Dll=dll, Mesh=mesh)  # -> Out, Hull

c_script_3 = CSharpScript(path="spec/StraightSkeleton.py", refresh=Button())  # -> out, A; inputs path: String, refresh: Boolean; same code as c_script
straightskeleton = Instance(Code=c_script_3.A, Dll=dll, Outer=pline_4, Inner=merge)  # -> Out, StraightSkeleton, Spokes, Envelope
panel = Panel(straightskeleton.Out)

medges = MeshEdges(Mesh=convexhull.Hull)  # -> NakedEdges, InteriorEdges, NonManifoldEdges
wires = BrepWireframe(Brep=optimalboundingbox.Obb, Density=-1)
merge_2 = Merge(Data1=medges.NakedEdges, Data2=medges.InteriorEdges, Data3=medges.NonManifoldEdges)
preview = CustomPreview(Geometry=mesh, Material=ColourSwatch(SwatchColor=RGBA(91, 143, 136, 106)))
preview_2 = CustomPreview(Geometry=merge_2, Material=ColourSwatch(SwatchColor=RGB(21, 255, 0)))
preview_3 = CustomPreview(Geometry=wires, Material=ColourSwatch(SwatchColor=RGB(255, 0, 0)))

preview_4 = CustomPreview(Geometry=[pline_4, merge], Material=ColourSwatch(SwatchColor=RGB(251, 255, 0)))
preview_5 = CustomPreview(Geometry=straightskeleton.StraightSkeleton, Material=ColourSwatch(SwatchColor=RGB(76, 176, 0)))
preview_6 = CustomPreview(Geometry=straightskeleton.Envelope, Material=ColourSwatch(SwatchColor=RGB(143, 127, 127)))
preview_7 = CustomPreview(Geometry=straightskeleton.Spokes, Material=ColourSwatch(SwatchColor=RGB(70, 112, 38)))
